# Grasshopper definition OS_VR_AM.gh (Grasshopper 1.0.7)
# plug-ins: NGon, LunchBox, Kangaroo2 Components

number_slider = Slider(1, range=0..100)  # disabled
number_slider_2 = Slider(1, range=0..100)  # disabled
graph = GraphMapper(
    Slider(0.917, range=0..1),
    x0=0,
    x1=1,
    y0=0,
    y1=1,
    container_name="Bezier",
    cpx=[0, 0.8707361817, 0.7078551054, 1],
    cpy=[0, 0.004542469978, 0.5254492164, 1])
number_slider_3 = Slider(1, range=0..100)  # disabled
number_slider_4 = Slider(29, range=0..100)  # disabled
number_slider_5 = Slider(29, range=0..100)  # disabled
number_slider_6 = Slider(1, range=0..100)  # disabled
number_slider_7 = Slider(1, range=0..100)  # disabled
number_slider_8 = Slider(20, range=0..100)  # disabled
number_slider_9 = Slider(36, range=0..100)  # disabled
number_slider_10 = Slider(21, range=0..100)  # disabled
number_slider_11 = Slider(1, range=0..100)  # disabled
number_slider_12 = Slider(29, range=0..100)  # disabled
number_slider_13 = Slider(1, range=0..100)  # disabled
number_slider_14 = Slider(1, range=0..100)  # disabled
number_slider_15 = Slider(44, range=0..100)  # disabled
number_slider_16 = Slider(1, range=0..100)  # disabled
number_slider_17 = Slider(29, range=0..100)  # disabled
number_slider_18 = Slider(29, range=0..100)  # disabled
number_slider_19 = Slider(29, range=0..100)  # disabled
number_slider_20 = Slider(1, range=0..100)  # disabled
number_slider_21 = Slider(1, range=0..100)  # disabled
number_slider_22 = Slider(11, range=0..100)  # disabled
number_slider_23 = Slider(29, range=0..100)  # disabled
number_slider_24 = Slider(8, range=0..100)  # disabled
number_slider_25 = Slider(11264, range=0..100000)  # disabled
number_slider_26 = Slider(11, range=0..100)  # disabled
graph_2 = GraphMapper(
    Slider(0.917, range=0..1),
    x0=0,
    x1=1,
    y0=0,
    y1=1,
    container_name="Bezier",
    cpx=[0, 0.8707361817, 0.7078551054, 1],
    cpy=[0, 0.004542469978, 0.5254492164, 1])
brep = Brep(<brep referenced from the Rhino model>)  # disabled
srf = Surface(<surface referenced from the Rhino model>)  # disabled
srf_2 = Surface(<surface referenced from the Rhino model>)  # disabled
srf_3 = Surface(<surface referenced from the Rhino model>)  # disabled
srf_4 = Surface(<surface referenced from the Rhino model>)  # disabled
srf_5 = Surface(<surface referenced from the Rhino model>)  # disabled
srf_6 = Surface(<surface referenced from the Rhino model>)  # disabled
srf_7 = Surface(<surface referenced from the Rhino model>)  # disabled
srf_8 = Surface(<surface referenced from the Rhino model>)  # disabled
series = Series(Start=0, Step=Slider(2, range=0..10), Count=Slider(7, range=0..10))
srf_9 = Surface(<surface referenced from the Rhino model>)  # disabled
srf_10 = Surface(<surface referenced from the Rhino model>)  # disabled
srf_11 = Surface(<surface referenced from the Rhino model>)  # disabled
srf_12 = Surface()  # disabled
cir = Circle(Plane=PlaneXY(0, 0, 0), Radius=Slider(19, range=0..100))
series_2 = Series(Start=0, Step=Slider(2, range=0..10), Count=Slider(7, range=0..10))
mesh = MeshBrep(
    Brep=brep,
    Settings={GridMaxCount=0, GridMinCount=16, JaggedSeams=False, MaxEdgeLength=0, MinEdgeLength=0.0001, MinTolerance=0, Refine=True, RefineAngle=0, RelativeTolerance=0.65, SimplePlanes=True, Tolerance=0})  # disabled
cir_2 = Circle(Plane=PlaneXY(0, 0, 0), Radius=Slider(19, range=0..100))
expression = Expression(x=graph, y=series, Expression="x^y")
number_slider_27 = Slider(4, range=0..200)
number_slider_28 = Slider(10, range=0..10)
diagrid = DiagridStructure(Surface=srf, UDivisions=number_slider, VDivisions=number_slider_4, Type=True)  # -> StructureLines, StructureNodes; disabled
diagrid_2 = DiagridStructure(Surface=srf_2, UDivisions=number_slider_2, VDivisions=number_slider_5, Type=True)  # -> StructureLines, StructureNodes; disabled
diagrid_3 = DiagridStructure(Surface=srf_3, UDivisions=number_slider_3, VDivisions=number_slider_8, Type=True)  # -> StructureLines, StructureNodes; disabled
clean = CombineClean(Meshes=mesh)  # disabled
diagrid_4 = DiagridStructure(Surface=srf_4, UDivisions=number_slider_6, VDivisions=number_slider_10, Type=True)  # -> StructureLines, StructureNodes; disabled
diagrid_5 = DiagridStructure(Surface=srf_5, UDivisions=number_slider_7, VDivisions=number_slider_12, Type=True)  # -> StructureLines, StructureNodes; disabled
diagrid_6 = DiagridStructure(Surface=srf_7, UDivisions=number_slider_11, VDivisions=number_slider_15, Type=True)  # -> StructureLines, StructureNodes; disabled
diagrid_7 = DiagridStructure(Surface=srf_8, UDivisions=number_slider_14, VDivisions=number_slider_17, Type=True)  # -> StructureLines, StructureNodes; disabled
diagrid_8 = DiagridStructure(Surface=srf_9, UDivisions=number_slider_16, VDivisions=number_slider_19, Type=True)  # -> StructureLines, StructureNodes; disabled
diagrid_9 = DiagridStructure(Surface=srf_11, UDivisions=number_slider_21, VDivisions=number_slider_23, Type=True)  # -> StructureLines, StructureNodes; disabled
expression_2 = Expression(x=graph_2, y=series_2, Expression="x^y")
diagrid_10 = DiagridStructure(Surface=srf_12, UDivisions=number_slider_22, VDivisions=number_slider_24, Type=True)  # -> StructureLines, StructureNodes; disabled
number_slider_29 = Slider(4, range=0..200)
number_slider_30 = Slider(10, range=0..10)
diagrid_11 = DiagridStructure(Surface=srf_6, UDivisions=number_slider_9, VDivisions=number_slider_13, Type=True)  # -> StructureLines, StructureNodes; disabled
diagrid_12 = DiagridStructure(Surface=srf_10, UDivisions=number_slider_18, VDivisions=number_slider_20, Type=True)  # -> StructureLines, StructureNodes; disabled
scale = Scale(Geometry=cir, Center=Point(0, 0, 0), Factor=expression)  # -> Geometry, Transform
srf_13 = Surface([<surface referenced from the Rhino model> x15])
scale_2 = Scale(Geometry=cir_2, Center=Point(0, 0, 0), Factor=expression_2)  # -> Geometry, Transform
series_3 = Series(Start=0, Step=Slider(2, range=0.1..10), Count=Slider(1, range=0..10))
series_4 = Series(Start=0, Step=Slider(2, range=0.1..10), Count=Slider(1, range=0..10))
Z = UnitZ(Factor=series_3)
diagrid_13 = DiagridStructure(Surface=srf_13, UDivisions=Slider(1, range=0..100), VDivisions=Slider(19, range=0..100), Type=True)  # -> StructureLines, StructureNodes
move = Move(Geometry=scale.Geometry, Motion=Z)  # -> Geometry, Transform
Z_2 = UnitZ(Factor=series_4)
move_2 = Move(Geometry=scale_2.Geometry, Motion=Z_2)  # -> Geometry, Transform
diagonal = DiagonalMesh()  # disabled
crv = Curve([<curve referenced from the Rhino model> x32])
crv_2 = Curve(diagrid_13.StructureLines)
multiplication = Multiplication(A=series, B=Slider(12.395, range=0..100))
crv_3 = Curve([<curve referenced from the Rhino model> x42])  # disabled
crv_4 = Curve([<curve referenced from the Rhino model> x8])  # disabled
crv_5 = Curve(<curve referenced from the Rhino model>)  # disabled
multiplication_2 = Multiplication(A=series_2, B=Slider(12.395, range=0..100))
faceb = FaceBoundaries(Mesh=diagonal)  # disabled
crv_6 = Curve([crv_2, crv])
rotate = Rotate(Geometry=move.Geometry, Angle=degrees(multiplication), Plane=PlaneXY(0, 0, 0))  # -> Geometry, Transform
project = Project(Curve=crv, Direction=Vector(0, 0, 1))
neg = Negative(Value=multiplication_2)
pipe = Pipe(
    Curve=[diagrid_9.StructureLines, diagrid_11.StructureLines, diagrid_12.StructureLines, diagrid_8.StructureLines, diagrid_7.StructureLines, diagrid_5.StructureLines, diagrid_2.StructureLines, diagrid.StructureLines, diagrid_4.StructureLines, diagrid_3.StructureLines, diagrid_6.StructureLines, crv_3, crv_4, crv_5],
    Radius=Slider(0.075, range=0..0.1),
    Caps=0)  # disabled
rotate_2 = Rotate(Geometry=move_2.Geometry, Angle=degrees(neg), Plane=PlaneXY(0, 0, 0))  # -> Geometry, Transform
divide = DivideCurve(Curve=rotate_2.Geometry, Count=Slider(15, range=0..100), Kinks=False)  # -> Points, Tangents, Parameters
points = PointList(Points=divide.Points, Size=5)
item = ListItem(List=divide.Points, Index=0, Wrap=True)  # -> Item, flatten(Item1), flatten(Item2), flatten(Item3), flatten(Item4), flatten(Item5), flatten(Item6), flatten(Item7)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
intcrv = Interpolate(Vertices=item.Item2, Degree=3, Periodic=False, KnotStyle=1)  # -> Curve, Length, Domain
intcrv_2 = Interpolate(Vertices=item.Item1, Degree=3, Periodic=False, KnotStyle=1)  # -> Curve, Length, Domain
intcrv_3 = Interpolate(Vertices=item.Item3, Degree=3, Periodic=False, KnotStyle=1)  # -> Curve, Length, Domain
intcrv_4 = Interpolate(Vertices=item.Item4, Degree=3, Periodic=False, KnotStyle=1)  # -> Curve, Length, Domain
intcrv_5 = Interpolate(Vertices=item.Item5, Degree=3, Periodic=False, KnotStyle=1)  # -> Curve, Length, Domain
intcrv_6 = Interpolate(Vertices=item.Item8, Degree=3, Periodic=False, KnotStyle=1)  # -> Curve, Length, Domain
intcrv_7 = Interpolate(Vertices=item.Item9, Degree=3, Periodic=False, KnotStyle=1)  # -> Curve, Length, Domain
intcrv_8 = Interpolate(Vertices=item.Item6, Degree=3, Periodic=False, KnotStyle=1)  # -> Curve, Length, Domain
intcrv_9 = Interpolate(Vertices=item.Item7, Degree=3, Periodic=False, KnotStyle=1)  # -> Curve, Length, Domain
intcrv_10 = Interpolate(Vertices=item.Item10, Degree=3, Periodic=False, KnotStyle=1)  # -> Curve, Length, Domain
intcrv_11 = Interpolate(Vertices=item.Item12, Degree=3, Periodic=False, KnotStyle=1)  # -> Curve, Length, Domain
intcrv_12 = Interpolate(Vertices=item.Item14, Degree=3, Periodic=False, KnotStyle=1)  # -> Curve, Length, Domain
intcrv_13 = Interpolate(Vertices=item.Item11, Degree=3, Periodic=False, KnotStyle=1)  # -> Curve, Length, Domain
intcrv_14 = Interpolate(Vertices=item.Item13, Degree=3, Periodic=False, KnotStyle=1)  # -> Curve, Length, Domain
intcrv_15 = Interpolate(Vertices=item.Item15, Degree=3, Periodic=False, KnotStyle=1)  # -> Curve, Length, Domain
divide_2 = DivideCurve(Curve=rotate.Geometry, Count=Slider(15, range=0..100), Kinks=False)  # -> Points, Tangents, Parameters
points_2 = PointList(Points=divide_2.Points, Size=5)
item_2 = ListItem(List=divide_2.Points, Index=0, Wrap=True)  # -> Item, flatten(Item1), flatten(Item2), flatten(Item3), flatten(Item4), flatten(Item5), flatten(Item6), flatten(Item7)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
merge = Merge(
    Data1=intcrv_2.Curve,
    Data2=intcrv.Curve,
    Data3=intcrv_3.Curve,
    Data4=intcrv_4.Curve,
    Data5=intcrv_5.Curve,
    Data6=intcrv_8.Curve,
    Data7=intcrv_9.Curve,
    Data8=intcrv_6.Curve,
    Data9=intcrv_7.Curve,
    Data10=intcrv_10.Curve,
    Data11=intcrv_13.Curve,
    Data12=intcrv_11.Curve,
    Data13=intcrv_14.Curve,
    Data14=intcrv_12.Curve,
    Data15=intcrv_15.Curve)
intcrv_16 = Interpolate(Vertices=item_2.Item2, Degree=3, Periodic=False, KnotStyle=1)  # -> Curve, Length, Domain
intcrv_17 = Interpolate(Vertices=item_2.Item1, Degree=3, Periodic=False, KnotStyle=1)  # -> Curve, Length, Domain
intcrv_18 = Interpolate(Vertices=item_2.Item3, Degree=3, Periodic=False, KnotStyle=1)  # -> Curve, Length, Domain
intcrv_19 = Interpolate(Vertices=item_2.Item4, Degree=3, Periodic=False, KnotStyle=1)  # -> Curve, Length, Domain
intcrv_20 = Interpolate(Vertices=item_2.Item5, Degree=3, Periodic=False, KnotStyle=1)  # -> Curve, Length, Domain
intcrv_21 = Interpolate(Vertices=item_2.Item8, Degree=3, Periodic=False, KnotStyle=1)  # -> Curve, Length, Domain
intcrv_22 = Interpolate(Vertices=item_2.Item9, Degree=3, Periodic=False, KnotStyle=1)  # -> Curve, Length, Domain
intcrv_23 = Interpolate(Vertices=item_2.Item6, Degree=3, Periodic=False, KnotStyle=1)  # -> Curve, Length, Domain
intcrv_24 = Interpolate(Vertices=item_2.Item7, Degree=3, Periodic=False, KnotStyle=1)  # -> Curve, Length, Domain
intcrv_25 = Interpolate(Vertices=item_2.Item10, Degree=3, Periodic=False, KnotStyle=1)  # -> Curve, Length, Domain
intcrv_26 = Interpolate(Vertices=item_2.Item12, Degree=3, Periodic=False, KnotStyle=1)  # -> Curve, Length, Domain
intcrv_27 = Interpolate(Vertices=item_2.Item14, Degree=3, Periodic=False, KnotStyle=1)  # -> Curve, Length, Domain
intcrv_28 = Interpolate(Vertices=item_2.Item11, Degree=3, Periodic=False, KnotStyle=1)  # -> Curve, Length, Domain
intcrv_29 = Interpolate(Vertices=item_2.Item13, Degree=3, Periodic=False, KnotStyle=1)  # -> Curve, Length, Domain
intcrv_30 = Interpolate(Vertices=item_2.Item15, Degree=3, Periodic=False, KnotStyle=1)  # -> Curve, Length, Domain
merge_2 = Merge(
    Data1=intcrv_17.Curve,
    Data2=intcrv_16.Curve,
    Data3=intcrv_18.Curve,
    Data4=intcrv_19.Curve,
    Data5=intcrv_20.Curve,
    Data6=intcrv_23.Curve,
    Data7=intcrv_24.Curve,
    Data8=intcrv_21.Curve,
    Data9=intcrv_22.Curve,
    Data10=intcrv_25.Curve,
    Data11=intcrv_28.Curve,
    Data12=intcrv_26.Curve,
    Data13=intcrv_29.Curve,
    Data14=intcrv_27.Curve,
    Data15=intcrv_30.Curve)
crv_7 = Curve([merge, merge_2])
number_slider_31 = Slider(1, range=0..100)
divide_3 = DivideCurve(Curve=merge_2, Count=10, Kinks=False)  # -> Points, Tangents, Parameters
Z_3 = UnitZ(Factor=expr("X*-1", Slider(0.902, range=0.1..10)))
number_slider_32 = Slider(0.1, range=0.1..10)
move_3 = Move(Geometry=merge_2, Motion=Z_3)  # -> Geometry, Transform
flip = FlipMatrix(Data=divide_3.Points)
rotate_3 = Rotate(Geometry=move_3.Geometry, Angle=degrees(Slider(20, range=0..100)), Plane=PlaneXY(0, 0, 0))  # -> Geometry, Transform
item_3 = ListItem(List=flip, Index=0, Wrap=True)  # -> flatten(Item), flatten(Item1), flatten(Item2), flatten(Item3), flatten(Item4), flatten(Item5), flatten(Item6), flatten(Item7)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
divide_4 = DivideCurve(Curve=rotate_3.Geometry, Count=10, Kinks=False)  # -> Points, Tangents, Parameters
flip_2 = FlipMatrix(Data=divide_4.Points)
item_4 = ListItem(List=flip_2, Index=0, Wrap=True)  # -> flatten(Item), flatten(Item1), flatten(Item2), flatten(Item3), flatten(Item4), flatten(Item5), flatten(Item6), flatten(Item7)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
item_5 = ListItem(List=flip, Index=0, Wrap=True)  # -> flatten(Item), flatten(Item1), flatten(Item2), flatten(Item3), flatten(Item4), flatten(Item5), flatten(Item6), flatten(Item7)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
weave = Weave(Pattern=[0, 1], Stream0=item_3.Item, Stream1=item_3.Item1, NullGaps=False)
weave_2 = Weave(Pattern=[0, 1], Stream0=item_3.Item1, Stream1=item_3.Item2, NullGaps=False)
weave_3 = Weave(Pattern=[0, 1], Stream0=item_3.Item2, Stream1=item_3.Item3, NullGaps=False)
weave_4 = Weave(Pattern=[0, 1], Stream0=item_3.Item3, Stream1=item_3.Item4, NullGaps=False)
weave_5 = Weave(Pattern=[0, 1], Stream0=item_3.Item4, Stream1=item_3.Item5, NullGaps=False)
weave_6 = Weave(Pattern=[0, 1], Stream0=item_3.Item5, Stream1=item_3.Item6, NullGaps=False)
weave_7 = Weave(Pattern=[0, 1], Stream0=item_3.Item6, Stream1=item_3.Item7, NullGaps=False)
weave_8 = Weave(Pattern=[0, 1], Stream0=item_3.Item7, Stream1=item_3.Item8, NullGaps=False)
weave_9 = Weave(Pattern=[0, 1], Stream0=item_3.Item8, Stream1=item_3.Item9, NullGaps=False)
weave_10 = Weave(Pattern=[0, 1], Stream0=item_3.Item9, Stream1=item_3.Item10, NullGaps=False)
weave_11 = Weave(Pattern=[0, 1], Stream0=item_3.Item10, Stream1=item_3.Item11, NullGaps=False)
weave_12 = Weave(Pattern=[0, 1], Stream0=item_3.Item11, Stream1=item_3.Item12, NullGaps=False)
weave_13 = Weave(Pattern=[0, 1], Stream0=item_3.Item12, Stream1=item_3.Item13, NullGaps=False)
weave_14 = Weave(Pattern=[0, 1], Stream0=item_3.Item13, Stream1=item_3.Item14, NullGaps=False)
weave_15 = Weave(Pattern=[0, 1], Stream0=item_3.Item14, Stream1=item_3.Item15, NullGaps=False)
pline = PolyLine(Vertices=weave, Closed=False)
pline_2 = PolyLine(Vertices=weave_2, Closed=False)
pline_3 = PolyLine(Vertices=weave_3, Closed=False)
pline_4 = PolyLine(Vertices=weave_4, Closed=False)
pline_5 = PolyLine(Vertices=weave_5, Closed=False)
pline_6 = PolyLine(Vertices=weave_6, Closed=False)
pline_7 = PolyLine(Vertices=weave_7, Closed=False)
pline_8 = PolyLine(Vertices=weave_8, Closed=False)
pline_9 = PolyLine(Vertices=weave_9, Closed=False)
pline_10 = PolyLine(Vertices=weave_10, Closed=False)
pline_11 = PolyLine(Vertices=weave_11, Closed=False)
pline_12 = PolyLine(Vertices=weave_12, Closed=False)
pline_13 = PolyLine(Vertices=weave_13, Closed=False)
pline_14 = PolyLine(Vertices=weave_14, Closed=False)
pline_15 = PolyLine(Vertices=weave_15, Closed=False)

ln = Line(StartPoint=item_5.Item1, EndPoint=item_4.Item)
ln_2 = Line(StartPoint=item_5.Item, EndPoint=item_4.Item)
ln_3 = Line(StartPoint=item_5.Item1, EndPoint=item_4.Item1)
ln_4 = Line(StartPoint=item_5.Item2, EndPoint=item_4.Item1)
ln_5 = Line(StartPoint=item_5.Item2, EndPoint=item_4.Item2)
ln_6 = Line(StartPoint=item_5.Item4, EndPoint=item_4.Item3)
ln_7 = Line(StartPoint=item_5.Item3, EndPoint=item_4.Item3)
ln_8 = Line(StartPoint=item_5.Item4, EndPoint=item_4.Item4)
ln_9 = Line(StartPoint=item_5.Item5, EndPoint=item_4.Item5)
ln_10 = Line(StartPoint=item_5.Item6, EndPoint=item_4.Item5)
ln_11 = Line(StartPoint=item_5.Item3, EndPoint=item_4.Item2)
ln_12 = Line(StartPoint=item_5.Item5, EndPoint=item_4.Item4)
ln_13 = Line(StartPoint=item_5.Item6, EndPoint=item_4.Item6)
ln_14 = Line(StartPoint=item_5.Item7, EndPoint=item_4.Item7)
ln_15 = Line(StartPoint=item_5.Item8, EndPoint=item_4.Item7)
ln_16 = Line(StartPoint=item_5.Item11, EndPoint=item_4.Item11)
ln_17 = Line(StartPoint=item_5.Item7, EndPoint=item_4.Item6)
ln_18 = Line(StartPoint=item_5.Item10, EndPoint=item_4.Item9)
ln_19 = Line(StartPoint=item_5.Item8, EndPoint=item_4.Item8)
ln_20 = Line(StartPoint=item_5.Item10, EndPoint=item_4.Item10)
ln_21 = Line(StartPoint=item_5.Item9, EndPoint=item_4.Item8)
ln_22 = Line(StartPoint=item_5.Item9, EndPoint=item_4.Item9)
ln_23 = Line(StartPoint=item_5.Item11, EndPoint=item_4.Item10)
ln_24 = Line(StartPoint=item_5.Item12, EndPoint=item_4.Item11)
ln_25 = Line(StartPoint=item_5.Item13, EndPoint=item_4.Item12)
ln_26 = Line(StartPoint=item_5.Item12, EndPoint=item_4.Item12)
ln_27 = Line(StartPoint=item_5.Item13, EndPoint=item_4.Item13)
ln_28 = Line(StartPoint=item_5.Item14, EndPoint=item_4.Item13)
ln_29 = Line(StartPoint=item_5.Item14, EndPoint=item_4.Item14)
ln_30 = Line(StartPoint=item_5.Item15, EndPoint=item_4.Item14)

merge_3 = Merge(
    Data1=ln_2,
    Data2=ln,
    Data3=ln_3,
    Data4=ln_4,
    Data5=ln_5,
    Data6=ln_11,
    Data7=ln_7,
    Data8=ln_6,
    Data9=ln_8,
    Data10=ln_12,
    Data11=ln_9,
    Data12=ln_10,
    Data13=ln_13,
    Data14=ln_17,
    Data15=ln_14,
    Data16=ln_15,
    Data17=ln_19,
    Data18=ln_21,
    Data19=ln_22,
    Data20=ln_18,
    Data21=ln_20,
    Data22=ln_23,
    Data23=ln_16,
    Data24=ln_24,
    Data25=ln_26,
    Data26=ln_25,
    Data27=ln_27,
    Data28=ln_28,
    Data29=ln_29,
    Data30=ln_30)
merge_4 = Merge(
    Data1=pline,
    Data2=pline_2,
    Data3=pline_3,
    Data4=pline_4,
    Data5=pline_5,
    Data6=pline_6,
    Data7=pline_7,
    Data8=pline_8,
    Data9=pline_9,
    Data10=pline_10,
    Data11=pline_11,
    Data12=pline_12,
    Data13=pline_13,
    Data14=pline_14,
    Data15=pline_15)
crv_8 = Curve(merge_2)
faceb_2 = FaceBoundaries()
brep_2 = Brep(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)
crv_9 = Curve([merge_4, crv_8])
number_slider_33 = Slider(0.086, range=0.01..2)  # disabled
number_slider_34 = Slider(0.086, range=0.01..2)  # disabled
project_2 = Project(Curve=crv_9, Brep=brep_2, Direction=Vector(0, 0, 1))
number_slider_35 = Slider(0.076, range=0.01..2)  # disabled
crv_10 = Curve(merge_4)  # disabled
number_slider_36 = Slider(0.076, range=0..0.1)
pipe_2 = Pipe(Curve=crv_10, Radius=number_slider_33, Caps=0)  # disabled
pipe_3 = Pipe(Curve=crv_8, Radius=number_slider_34, Caps=0)  # disabled
pipe_4 = Pipe(Curve=merge_3, Radius=number_slider_35, Caps=0)  # disabled
