# Grasshopper definition Parametric Urbanism Grasshopper.gh (Grasshopper 1.0.7)

number_slider = Slider(20, range=0..100)
sqgrid = Square(Plane=PlaneXY(0, 0, 0), Size=1, ExtentX=number_slider, ExtentY=number_slider)  # -> Cells, Points
explode = Explode(Curve=sqgrid.Cells, Recursive=True)  # -> Segments, Vertices
cull_i = CullIndex(List=explode.Vertices, Indices="-1", Wrap=True)
geo = Geometry(cull_i)
geo_2 = Geometry(<curve referenced from the Rhino model>)
geo_3 = Geometry(<curve referenced from the Rhino model>)
crv_cp = CurveClosestPoint(Point=geo, Curve=geo_2)  # -> Point, Parameter, Distance
crv_cp_2 = CurveClosestPoint(Point=geo, Curve=geo_3)  # -> Point, Parameter, Distance
vec2pt = Vector2Pt(PointA=geo, PointB=crv_cp_2.Point, Unitize=False)  # -> Vector, Length
vec2pt_2 = Vector2Pt(PointA=geo, PointB=crv_cp.Point, Unitize=False)  # -> Vector, Length
addition = Addition(A=vec2pt.Vector, B=vec2pt_2.Vector)
division = Division(A=addition, B=Slider(5.1667, range=0..10))
move = Move(Geometry=geo, Motion=division)  # -> Geometry, Transform
avr = Average(Input=move.Geometry)  # -> flatten(ArithmeticMean)
pt = Point(<point referenced from the Rhino model>)
pt_2 = Point(<point referenced from the Rhino model>)
pt_3 = Point(<point referenced from the Rhino model>)
item = ListItem(List=move.Geometry, Index=0, Wrap=True)  # -> Item, Item1, Item2, Item3
dist = Distance(PointA=avr, PointB=pt)
dist_2 = Distance(PointA=avr, PointB=pt_3)
dist_3 = Distance(PointA=avr, PointB=pt_2)
extrz = Extremes(A=dist, B=dist_2, C=dist_3)  # -> Mininum, Maximum
srf4pt = _4PointSurface(CornerA=item.Item, CornerB=item.Item1, CornerC=item.Item2, CornerD=item.Item3)
bnd = Bounds(Numbers=extrz.Mininum)
dom = ConstructDomain(DomainStart=Slider(0, range=0..100), DomainEnd=Slider(5, range=0..10))
div = DivideDomain(Domain=dom, Count=Slider(3, range=0..10))  # -> graft(Segments)
remap = RemapNumbers(Value=extrz.Mininum, Source=bnd, Target=dom)  # -> Mapped, Clipped
inc = Includes(Value=remap.Mapped, Domain=div)  # -> Includes, Deviation
flip = FlipMatrix(Data=inc.Includes)
item_2 = ListItem(List=flip, Index=0, Wrap=True)  # -> Item, Item1, Item2
cull = CullPattern(List=flatten(srf4pt), CullPattern=flatten(item_2.Item))
cull_2 = CullPattern(List=flatten(remap.Mapped), CullPattern=flatten(item_2.Item2))
cull_3 = CullPattern(List=flatten(srf4pt), CullPattern=flatten(item_2.Item2))
cull_4 = CullPattern(List=flatten(remap.Mapped), CullPattern=flatten(item_2.Item))
cull_5 = CullPattern(List=flatten(remap.Mapped), CullPattern=flatten(item_2.Item1))
cull_6 = CullPattern(List=flatten(srf4pt), CullPattern=flatten(item_2.Item1))
dom²num = ConstructDomain²(UMin=0, UMax=1, VMin=0, VMax=1)
dom²num_2 = ConstructDomain²(UMin=0, UMax=1, VMin=0, VMax=1)
dom²num_3 = ConstructDomain²(UMin=0, UMax=1, VMin=0, VMax=1)
sbox = SurfaceBox(Surface=reparameterize(cull_6), Domain=dom²num, Height=cull_5)
sbox_2 = SurfaceBox(Surface=reparameterize(cull_3), Domain=dom²num_2, Height=cull_2)
sbox_3 = SurfaceBox(Surface=reparameterize(cull), Domain=dom²num_3, Height=cull_4)
geo_4 = Geometry([<brep referenced from the Rhino model> x2])
geo_5 = Geometry([<brep referenced from the Rhino model> x2])
geo_6 = Geometry([<brep referenced from the Rhino model> x2])
bbox = BoundingBox(Content=geo_4, Plane=PlaneXY(0, 0, 0), UnionBox=True)  # -> Box, Box_2
bbox_2 = BoundingBox(Content=geo_5, Plane=PlaneXY(0, 0, 0), UnionBox=True)  # -> Box, Box_2
bbox_3 = BoundingBox(Content=geo_6, Plane=PlaneXY(0, 0, 0), UnionBox=True)  # -> Box, Box_2
morph = BoxMorph(Geometry=geo_4, Reference=bbox.Box, Target=graft(sbox))
morph_2 = BoxMorph(Geometry=geo_5, Reference=bbox_2.Box, Target=graft(sbox_2))
morph_3 = BoxMorph(Geometry=geo_6, Reference=bbox_3.Box, Target=graft(sbox_3))
