# Grasshopper definition Sine Wall Grasshopper Definition.gh (Grasshopper 1.0.7)

X = UnitX(Factor=Slider(1, range=0..1))
pt = Point(Point(-2.147763112, 25.34678374, 0))
X_2 = UnitX(Factor=Slider(1, range=0..1))
pt_2 = Point(Point(-2.147763112, 25.34678374, 0))
arrlinear = LinearArray(Geometry=pt, Direction=X, Count=Slider(25, range=0..100))  # -> Geometry, Transform
arrlinear_2 = LinearArray(Geometry=pt_2, Direction=X_2, Count=Slider(25, range=0..100))  # -> Geometry, Transform
pdecon = Deconstruct(Point=arrlinear.Geometry)  # -> XComponent, YComponent, ZComponent
pdecon_2 = Deconstruct(Point=arrlinear_2.Geometry)  # -> XComponent, YComponent, ZComponent
sin = Sine(Value=pdecon_2.XComponent)
sin_2 = Sine(Value=pdecon.XComponent)
neg = Negative(Value=sin)
pt_3 = ConstructPoint(XCoordinate=pdecon.XComponent, YCoordinate=sin_2, ZCoordinate=0)
pt_4 = ConstructPoint(XCoordinate=pdecon_2.XComponent, YCoordinate=neg, ZCoordinate=0)
intcrv = Interpolate(Vertices=pt_3, Degree=3, Periodic=False, KnotStyle=1)  # -> Curve, Length, Domain
intcrv_2 = Interpolate(Vertices=pt_4, Degree=3, Periodic=False, KnotStyle=1)  # -> Curve, Length, Domain
Z = UnitZ(Factor=Slider(5, range=0..10))
move = Move(Geometry=intcrv_2.Curve, Motion=Z)  # -> Geometry, Transform
divide = DivideCurve(Curve=move.Geometry, Count=Slider(150, range=0..1000), Kinks=False)  # -> Points, Tangents, Parameters
divide_2 = DivideCurve(Curve=intcrv.Curve, Count=Slider(150, range=0..1000), Kinks=False)  # -> Points, Tangents, Parameters
ln = Line(StartPoint=divide_2.Points, EndPoint=divide.Points)
rectangle = Rectangle(Plane=divide_2.Points, XSize=Slider(0.06, range=0..0.1), YSize=Slider(0.25, range=0..1), Radius=0)  # -> Rectangle, Length
extrcrv = ExtrudeAlong(Base=ln, Curve=rectangle.Rectangle)
cap = CapHoles(Brep=extrcrv)
preview = CustomPreview(Geometry=cap, Material=ColourSwatch(SwatchColor=RGB(255, 255, 255)))
