# Grasshopper definition Weaverbird_Voronoi Definition.gh (Grasshopper 1.0.7)
# plug-ins: Weaverbird

X = UnitX(Factor=Slider(0.14, range=0..1))
pt = ConstructPoint(XCoordinate=0, YCoordinate=0, ZCoordinate=0)
arrlinear = LinearArray(Geometry=pt, Direction=X, Count=Slider(1000, range=0..1000))  # -> Geometry, Transform
pdecon = Deconstruct(Point=arrlinear.Geometry)  # -> XComponent, YComponent, ZComponent
expression = Expression(x=pdecon.XComponent, Expression="x*sin(x)")
expression_2 = Expression(x=pdecon.XComponent, Expression="x*cos(x)")
expression_3 = Expression(x=pdecon.XComponent, Expression="x*tan(x)")
number_slider = Slider(181, range=0..1000)
pt_2 = ConstructPoint(XCoordinate=expression, YCoordinate=expression_2, ZCoordinate=expression_3)
box = CenterBox(Base=PlaneXY(0, 0, 0), X=number_slider, Y=number_slider, Z=Slider(507, range=0..1000))
brepinc = PointInBrep(Brep=box, Point=pt_2, Strict=False)
cull = CullPattern(List=pt_2, CullPattern=brepinc)
voronoi³ = Voronoi3D(Points=cull)  # -> Cells, Boundary
debrep = DeconstructBrep(Brep=voronoi³.Cells)  # -> Faces, Edges, Vertices
area = Area(Geometry=debrep.Faces)  # -> Area, Centroid
area_2 = Area(Geometry=voronoi³.Cells)  # -> Area, Centroid
scale = Scale(Geometry=debrep.Faces, Center=area.Centroid, Factor=Slider(0.6, range=0..1))  # -> Geometry, Transform
scale_2 = Scale(Geometry=debrep.Faces, Center=graft(area_2.Centroid), Factor=Slider(0.54, range=0..1))  # -> Geometry, Transform
debrep_2 = DeconstructBrep(Brep=scale.Geometry)  # -> Faces, Edges, Vertices
debrep_3 = DeconstructBrep(Brep=scale_2.Geometry)  # -> Faces, Edges, Vertices
rulesrf = RuledSurface(CurveA=debrep_2.Edges, CurveB=debrep_3.Edges)
debrep_4 = DeconstructBrep(Brep=rulesrf)  # -> Faces, Edges, simplify(Vertices)
smesh = SimpleMesh(Brep=debrep_4.Faces)
wbjoin = WeaverbirdsJoinMeshesAndWeld(Mesh=flatten(smesh), Weld=invert(False))
wbcatmullclark = WeaverbirdsCatmullClarkSubdivision(MeshCurves=wbjoin, Level=Slider(3, range=0..10), SmoothNakedEdges=1)
preview = CustomPreview(
    Geometry=wbcatmullclark,
    Material={diffuse=RGB(221, 160, 221), emission=RGB(66, 48, 66), shine=0.5, specular=RGB(255, 255, 255), transparency=0})
